# Dynamo graph Indexed Family Instances.dyn

xyz_zero = XYZZero(lacing=Longest)
family_type_selector = FamilyTypeSelector(index=18)
create_family_instance = FamilyInstanceCreatorXYZ(xyz_zero, family_type_selector, lacing=Longest)
string = StringInput("Offset")
string_2 = StringInput("increment")
list = NewList(index0=string, index1=string_2)
number = DoubleInput(1)
number_slider = DoubleSliderInput(20, range=0..20)
number_2 = DoubleInput(1)
number_sequence = BuildSeq(number, number_slider, number_2, lacing=Longest)
set_family_instance_parameter = FamilyInstanceParameterSetter(create_family_instance, list, number_sequence, lacing=Longest)
